# Dynamo graph script.dyn (Dynamo 3.5.0.8297)

categories = Categories("OST_Sheets")
all_elements_of_category = ElementsOfCategory(Category=categories)
code_block = CodeBlock { "Appears In Sheet List"; }
getParameterValueByName = Element.GetParameterValueByName(element=all_elements_of_category, parameterName=code_block)
code_block_2 = CodeBlock { 1; }
eq = getParameterValueByName == code_block_2
filterByBoolMask = List.FilterByBoolMask(list=all_elements_of_category, mask=eq)
code_block_3 = CodeBlock { "Number"; }
getParameterValueByName_2 = Element.GetParameterValueByName(element=filterByBoolMask.in, parameterName=code_block_3)
list_create = List.Create(item0=getParameterValueByName_2, item1=filterByBoolMask.in)
lastItem = List.LastItem(list=list_create)
firstItem = List.FirstItem(list=list_create)
code_block_4 = CodeBlock { "-"; }
split = String.Split(string=firstItem@L2, separator0=code_block_4)
lastItem_2 = List.LastItem(list=split@L2)
code_block_5 = CodeBlock { 6; "0"; }
padLeft = String.PadLeft(string=lastItem_2, newLength=code_block_5.out0, padChars=code_block_5.out1)
sortByKey = List.SortByKey(list=lastItem, keys=padLeft)
numbering_parameter_name = StringInput("Number")  # graph input
code_block_6 = CodeBlock { 1; }
count = List.Count(list=filterByBoolMask.in)
sequence = Sequence(start=code_block_6, amount=count, step=code_block_6)
setParameterByName = Element.SetParameterByName(element=sortByKey.sortedList, parameterName=numbering_parameter_name, value=sequence)
